# Grasshopper definition main.gh (Grasshopper 1.0.7)

crv = Curve(<curve referenced from the Rhino model>)
python = GhPythonScript(boundary=crv)  # -> out, segments; inputs boundary: Curve
# ---------- python: Python ----------
import fx
import cPickle

reload(fx)

from fx.utils import explode
from fx.window import draw_window

building_elements = cPickle.load(open('.\\fx\\building_elements_list.pkl'))
# ---------- end python ----------
