# Grasshopper definition mesh_contour_to_volume.gh (Grasshopper 1.0.7)

brep = Brep(<brep referenced from the Rhino model>)
unit_z = UnitZ(Factor=Slider(5, range=0..10))
extrude = Extrude(Base=brep, Direction=unit_z)
deconstruct_brep = DeconstructBrep(Brep=extrude)  # -> Faces, Edges, Vertices
point = Point(Point(0, 0, 0))
evaluate_surface = EvaluateSurface(Surface=reparameterize(deconstruct_brep.Faces), Point=point)  # -> Point, Normal, UDirection, VDirection, Frame
deconstruct_vector = DeconstructVector(Vector=evaluate_surface.Normal)  # -> XComponent, YComponent, ZComponent
smaller_than = SmallerThan(FirstNumber=deconstruct_vector.ZComponent, SecondNumber=1e-10)  # -> SmallerThan, OrEqualTo
larger_than = LargerThan(FirstNumber=deconstruct_vector.ZComponent, SecondNumber=1e-10)  # -> LargerThan, OrEqualTo
dispatch = Dispatch(List=deconstruct_brep.Faces, DispatchPattern=larger_than.LargerThan)  # -> ListA, ListB
dispatch_2 = Dispatch(List=deconstruct_brep.Faces, DispatchPattern=smaller_than.SmallerThan)  # -> ListA, ListB
unit_z_2 = UnitZ(Factor=-100)
surface = Surface(dispatch.ListB)
surface_2 = Surface(dispatch_2.ListB)
extrude_2 = Extrude(Base=surface_2, Direction=unit_z_2)
deconstruct_brep_2 = DeconstructBrep(Brep=extrude_2)  # -> Faces, Edges, Vertices
point_2 = Point(Point(0, 0, 0))
evaluate_surface_2 = EvaluateSurface(Surface=deconstruct_brep_2.Faces, Point=point_2)  # -> Point, Normal, UDirection, VDirection, Frame
deconstruct_vector_2 = DeconstructVector(Vector=evaluate_surface_2.Normal)  # -> XComponent, YComponent, ZComponent
smaller_than_2 = SmallerThan(FirstNumber=deconstruct_vector_2.ZComponent, SecondNumber=0)  # -> SmallerThan, OrEqualTo
dispatch_3 = Dispatch(List=deconstruct_brep_2.Faces, DispatchPattern=smaller_than_2.SmallerThan)  # -> ListA, ListB
surface_3 = Surface(dispatch_3.ListA)
project = Project(Geometry=simplify(surface_3), Plane=PlaneXY(0, 0, 0))  # -> Geometry, Transform
surface_4 = Surface(simplify(graft(surface_2)))
merge = Merge(Data1=surface_4, Data2=project.Geometry)
flip_matrix = FlipMatrix(Data=merge)
loft = Loft(Curves=merge, Options={Adjust=False, Closed=False, LoftEnds=0, LoftSimp=0, LoftType=0, Rebuild=10, Refit=0.01})
merge_2 = Merge(Data1=merge, Data2=loft)
brep_join = BrepJoin(Breps=merge_2)  # -> flatten(Breps), Closed
