# Grasshopper definition visualizer.gh (Grasshopper 1.0.7)

python = GhPythonScript()  # -> out, a
# ---------- python: Python ----------
import json

building_json = open('C:\\Users\\dpemr\\Desktop\\Documentary\\Project Files\\DPA\\project-2023-1\\New_DongHyuk\\main\\.json_cache\\builing\\buildings.json','r')
a = json.load(building_json)
print(a[0]['geometry'])
# ---------- end python ----------
