# Grasshopper definition main(1).gh (Grasshopper 1.0.7)

crv = Curve(<curve referenced from the Rhino model>)
python = GhPythonScript(boundary=crv)  # -> out, segments, a; inputs boundary: Curve
# ---------- python: Python ----------
import fx

reload(fx)

reload(fx.utils)
reload(fx.window)
reload(fx.tree)
from fx.utils import explode
from fx.window import draw_window
from fx.tree import *


tree_radius = 2000
num_points = 10
a = main(tree_radius, num_points)

#draw_window(segments[0])
# ---------- end python ----------
item = ListItem(List=python.segments, Index=Slider(0, range=0..10), Wrap=True)
