# Grasshopper definition main.gh (Grasshopper 1.0.7)

crv = Curve(<curve referenced from the Rhino model>)
number_slider = Slider(0, range=0..10)
pt = Point(Point(20847.01691, -13760.34863, 0))
incurve = PointInCurve()  # -> Relationship, Point
crv_2 = Curve(<curve referenced from the Rhino model>)
python = GhPythonScript(boundary=crv)  # -> out, segments, a, voronoi_curves, street_curves, tree_points, circles; inputs boundary: Curve
# ---------- python: Python ----------
import fx

reload(fx)
reload(fx.utils)
reload(fx.tree_new)

from fx.window import draw_window
from fx.tree_new import main
from fx.tree_new import draw_trees
seed_count = 20
#draw_window(segments[0])

voronoi_curves, street_curves, tree_points, a= main(seed_count,boundary)
print(voronoi_curves, street_curves, tree_points)
circles = draw_trees(tree_points)
print(circles)
# ---------- end python ----------
python_2 = GhPythonScript(pt=pt, boundary=crv_2)  # -> out, a; inputs pt: Point3d, boundary: Curve
# ---------- python_2: Python ----------
import fx

reload(fx)
reload(fx.utils)
reload(fx.tree_new)
from fx.window import draw_window
from fx.tree_new import check_contain

print(check_contain(pt, boundary))
# ---------- end python_2 ----------
python_3 = GhPythonScript()  # -> out, pts
# ---------- python_3: Python ----------
import scriptcontext as sc
pts = sc.sticky["pts"]
# ---------- end python_3 ----------
pt_2 = Point(python.tree_points)
crv_3 = Curve(python.a)
crv_4 = Curve(python.circles)
