# Grasshopper definition visualizer.gh (Grasshopper 1.0.7)

python = GhPythonScript()  # -> out, a
# ---------- python: Python ----------
building_json = open('./main/.json_cache/building.json','r')
# ---------- end python ----------
